# Grasshopper definition 00_geo.ghx (Grasshopper 1.0.8)

# Design
number_slider = Slider(0.1, range=0..1)
line = Line([Line((1.614691864, -0.9738324675, -0.7182930352), (2.525141228, -1.401381656, -0.7182930352)), Line((1.614691864, -0.9738324675, -0.7182930352), (2.525141228, -0.9738324675, -0.7182930352)), Line((2.525141228, -0.9738324675, -0.7182930352), (2.525141228, -1.401381656, -0.7182930352)), Line((2.525141228, -0.9738324675, -0.7182930352), (3.236425144, -0.9738324675, -0.7182930352)), Line((3.236425144, -1.735402277, -0.7182930352), (2.525141228, -1.401381656, -0.7182930352)), Line((3.236425144, -1.735402277, -0.7182930352), (3.236425144, -0.9738324675, -0.7182930352))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])
widths = Number([0.05, 0.05, 0.05, 0.05, 0.05, 0.05, 0.05, 0.05, 0.05, 0.05, 0.05, 0.05, 0.05, 0.05])
point = Point([Point(1.614691864, -0.9738324675, -0.7182930352), Point(2.525141228, -0.9738324675, -0.7182930352), Point(2.525141228, -1.401381656, -0.7182930352), Point(3.236425144, -0.9738324675, -0.7182930352), Point(3.236425144, -1.735402277, -0.7182930352), Point(3.881981114, -0.9738324675, -0.7182930352), Point(2.780884229, -1.247655823, -0.7182930352), Point(3.612068176, -1.292251868, -0.7182930352)])
point_list = PointList(Points=point, Size=number_slider)
heights = Number([0.06, 0.06, 0.06, 0.06, 0.06, 0.06, 0.06, 0.06, 0.06, 0.06, 0.06, 0.06, 0.06, 0.06])
# Import
python_3_script = Python3Script(read=Toggle(True), file_name="truss_01")  # -> out, truss, nodes, beams, cut_rectangles; inputs read: Boolean, file_name: String
# ---------- python_3_script: Python ----------
import os
import sys
import importlib
HERE = ghdoc.Path
path =  os.path.abspath(os.path.join(HERE, '..', '..', 'python'))

if path not in sys.path:
    sys.path.append(path)

if "geometry" in sys.modules:
    importlib.reload(sys.modules["geometry"])

JSON = os.path.abspath(os.path.join(HERE, '..', '..', 'json'))
file_path = JSON + "/" + file_name + ".json"

from geometry import Truss

if read:
    truss = Truss.from_json(file_path)
    nodes = truss.nodes
    beams = truss.beams
    for beam in beams:
        print(beam.width, beam.reference_width)
    
    truss.cut_all_beams()
    cut_rectangles = [b.cut_polyline for b in truss.beams]
# ---------- end python_3_script ----------
# Convert to Truss
python_3_script_2 = Python3Script(points=point, lines=line, widths=widths, heights=heights)  # -> out, cut_rectangles, rectangles, truss, beams, beam_ids, points, nodes; inputs points: list of Point3d, lines: list of Line, widths: list of Double, heights: list of Double
# ---------- python_3_script_2: Python ----------
import os
import sys
import importlib
HERE = ghdoc.Path
path =  os.path.abspath(os.path.join(HERE, '..', '..', 'python'))

if path not in sys.path:
    sys.path.append(path)

if "geometry" in sys.modules:
    importlib.reload(sys.modules["geometry"])

from geometry import Truss, Beam, Node

#make truss
truss = Truss()

for p in points:
    truss.add_node(p)

for l,h,w in zip(lines, heights, widths):
    truss.add_beam(l,h,w)

beams = truss.beams
nodes = truss.nodes

beam_ids = [b.id for b in truss.beams]
points = [b.centroid for b in truss.beams]

#get cut geometry

truss.cut_all_beams()

cut_rectangles = [b.cut_polyline for b in truss.beams]
rectangles = [b.uncut_polyline for b in truss.beams]
# ---------- end python_3_script_2 ----------
# Export
python_3_script_3 = Python3Script(truss=python_3_script_2.truss, export=Toggle(True), file_name="truss")  # -> out, cut_rectangles, rectangles, truss; inputs file_name: String
# ---------- python_3_script_3: Python ----------
import os
import sys
import importlib
HERE = ghdoc.Path
path =  os.path.abspath(os.path.join(HERE, '..', '..', 'python'))

if path not in sys.path:
    sys.path.append(path)

if "geometry" in sys.modules:
    importlib.reload(sys.modules["geometry"])

JSON = os.path.abspath(os.path.join(HERE, '..', '..', 'json'))
file_path = JSON + "/" + file_name + ".json"

if path not in sys.path:
    sys.path.append(path)

if export:
    truss.to_json(file_path)
# ---------- end python_3_script_3 ----------
curve = Curve(python_3_script.cut_rectangles)
text_tag = TextTag(Location=python_3_script_2.points, Text=python_3_script_2.beam_ids, Colour=ColourSwatch(SwatchColor=RGB(255, 255, 255)))
geometry = Geometry(python_3_script_2.cut_rectangles)
custom_preview = CustomPreview(Geometry=python_3_script.cut_rectangles, Material=ColourSwatch(SwatchColor=RGB(0, 255, 85)))
panel = Panel(python_3_script.out)
custom_preview_2 = CustomPreview(Geometry=geometry, Material=ColourSwatch(SwatchColor=RGB(255, 0, 0)))
# place 0,1 and change width of 2
python_3_script_4 = Python3Script(truss=python_3_script_3.truss, export=Toggle(True), file_name="truss_01")  # -> out, cut_rectangles, rectangles, truss; inputs file_name: String
# ---------- python_3_script_4: Python ----------
import os
import sys
import importlib
HERE = ghdoc.Path
path =  os.path.abspath(os.path.join(HERE, '..', '..', 'python'))

if path not in sys.path:
    sys.path.append(path)

if "geometry" in sys.modules:
    importlib.reload(sys.modules["geometry"])

JSON = os.path.abspath(os.path.join(HERE, '..', '..', 'json'))
file_path = JSON + "/" + file_name + ".json"

#beams 0, 1 have been placed
truss.beams[0].fabricated = True
truss.beams[1].fabricated = True
truss.beams[2].width = 0.09


if export:
    truss.to_json(file_path)
# ---------- end python_3_script_4 ----------
panel_2 = Panel(python_3_script_2.beams)
panel_3 = Panel(python_3_script.truss)
panel_4 = Panel(python_3_script_2.nodes)
panel_5 = Panel(python_3_script_2.truss)
geometry_2 = Geometry(geometry)
explode = Explode(Curve=geometry_2, Recursive=True)  # -> Segments, Vertices
panel_6 = Panel(python_3_script.beams)
panel_7 = Panel(python_3_script.nodes)
panel_8 = Panel(explode.Vertices)
